% Simulink data dictionary test_msg_gen.sldd

Topic2 = Simulink.Bus()
  TrucbiduleVar: boolean[200]  % Boolean Array
  MaVar2: single
  elem0: double

Topic1 = Simulink.Bus()
  elem0: Bus: workingCopy, Unit="pts"  % Description Test1
  elem1: double[100]  % List of Double